# Grasshopper definition YTP_re.gh (Grasshopper 0.9.80)
# plug-ins: Python Interpreter

path = FilePath("/Users/miuratakahiro/workspace/project/mayfes2018/labels5.csv")

# ---- group: Center Point / Center Point Scaling
number_slider = Slider(5000, range=0..100000)

# ----
path_2 = FilePath("/Users/miuratakahiro/workspace/project/mayfes2018/links5.csv")
file = ReadFile(File=path, PerLineParse=True)
file_2 = ReadFile(File=path_2, PerLineParse=True)
split = TextSplit(Text=file, Separators=",")
split_2 = TextSplit(Text=file_2, Separators=",")  # -> simplify(Result)
flip = FlipMatrix(Data=split_2)  # -> simplify(Data)
cull_i = CullIndex(List=flip, Indices="0", Wrap=True)
flatten = FlattenTree(Path="{0}")
flatten_2 = FlattenTree(Path="{0}")
flatten_3 = FlattenTree(Path="{0}")
flip_2 = FlipMatrix(Data=split)  # -> simplify(Data)
bang = ExplodeTree(Data=cull_i)  # -> simplify(Branch0), simplify(Branch1), simplify(Branch2), simplify(Branch3), simplify(graft(Branch4)), simplify(graft(Branch5))
cull_i_2 = CullIndex(List=flip_2, Indices="0", Wrap=True)
bang_2 = ExplodeTree(Data=cull_i_2)  # -> simplify(graft(Branch0)), simplify(graft(Branch1)), simplify(graft(Branch2))
int = Integer(bang_2.Branch2)
panel = Panel(bang.Branch5)

# ---- group: Center Point
pt = ConstructPoint(XCoordinate=0, YCoordinate=0, ZCoordinate=0)

# ---- group: Tag Data Reading
path_3 = FilePath("/Users/miuratakahiro/workspace/project/mayfes2018/nodes5.csv")
file_3 = ReadFile(File=path_3, PerLineParse=True)  # -> flatten(Content)
split_3 = TextSplit(Text=file_3, Separators=",")
flip_3 = FlipMatrix(Data=split_3)  # -> simplify(Data)
cull_i_3 = CullIndex(List=flip_3, Indices="0", Wrap=True)
bang_3 = ExplodeTree(Data=cull_i_3)  # -> simplify(graft(Branch0)), simplify(graft(Branch1)), simplify(graft(Branch2)), simplify(graft(Branch3)), simplify(graft(Branch4)), simplify(graft(Branch5)), simplify(graft(Branch6)), simplify(graft(Branch7))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

# ----
item = ListItem(List=flatten, Index=bang.Branch4, Wrap=True)
item_2 = ListItem(List=flatten_2, Index=bang.Branch4, Wrap=True)
item_3 = ListItem(List=flatten_3, Index=bang.Branch4, Wrap=True)
item_4 = ListItem(List=flatten, Index=bang.Branch5, Wrap=True)
item_5 = ListItem(List=flatten_2, Index=bang.Branch5, Wrap=True)
item_6 = ListItem(List=flatten_3, Index=bang.Branch5, Wrap=True)
setcolour = GhPythonScript(input=int)  # -> h
# ---------- setcolour: Python ----------
__author__ = "Akihito TAKEUCHI"
__version__ = "2018.05.18"

if input == 0:
    h = 0
if input == 1:
    h = 0.2
if input == 2:
    h = 0.4
if input == 3:
    h = 0.6
if input == 4:
    h = 0.8
# ---------- end setcolour ----------
pt_2 = ConstructPoint(XCoordinate=item, YCoordinate=item_2, ZCoordinate=item_3)
pt_3 = ConstructPoint(XCoordinate=item_4, YCoordinate=item_5, ZCoordinate=item_6)
ln = Line(StartPoint=pt_2, EndPoint=pt_3)
python = GhPythonScript(x=bang_3.Branch7, y=Slider(0.5, range=0..1))  # -> a
# ---------- python: Python ----------
__author__ = "Akihito TAKEUCHI"
__version__ = "2018.05.11"

import rhinoscriptsyntax as rs

if x == "0":
    a = y
else: a = x
# ---------- end python ----------
division = Division(B=python)

# ---- group: Making Spere
number_slider_2 = Slider(0.1, range=0..1)
sph = Sphere(Base=pt, Radius=division)

# ----
pipe = Pipe(Curve=ln, Radius=Slider(10, range=0..10), Caps=0)
number_slider_3 = Slider(0.3, range=0..1)
number_slider_4 = Slider(1, range=0..1)
number_slider_5 = Slider(1, range=0..1)
number_slider_6 = Slider(0.1, range=0..1)
preview = CustomPreview(Geometry=pipe, Material=ColourSwatch(SwatchColor=RGBA(97, 97, 97, 45)))
tag = TextTag3D(
    Location=pt,
    Text=bang_3.Branch1,
    Size=1,
    Colour=ColourSwatch(SwatchColor=RGB(255, 255, 255)),
    Justification=Slider(5, range=0..10))
preview_2 = CustomPreview(Geometry=sph)

# ---- group: Center Point / Center Point Data Reading
path_4 = FilePath("/Users/miuratakahiro/workspace/project/mayfes2018/position/position5.csv")
file_4 = ReadFile(File=path_4, PerLineParse=True)  # -> flatten(Content)
split_4 = TextSplit(Text=file_4, Separators=",")
flip_4 = FlipMatrix(Data=split_4)  # -> simplify(Data)

# ----
cull_i_4 = CullIndex(List=flip_4, Indices="0", Wrap=True)

# ---- group: Center Point / Center Point Data Reading (continued)
bang_4 = ExplodeTree(Data=cull_i_4)  # -> simplify(graft(Branch0)), simplify(graft(Branch1)), simplify(graft(Branch2)), simplify(graft(Branch3))
